# Grasshopper definition pluginproject.gh (Grasshopper 1.0.8)

panel = Panel("""Office
Meeting room
Reception""")
number_slider = Slider(30, range=0..30)
number_slider_2 = Slider(40, range=0..40)
panel_2 = Panel("""20
30
40""")
panel_3 = Panel("""10
2
1""")
c_script = CSharpScript(
    length=number_slider,
    width=number_slider_2,
    front=Slider(6, range=0..10),
    rear=Slider(4, range=0..10),
    side=Slider(3, range=0..10))  # -> siteCurve, siteCurve_2, buildableCurve, buildableArea; inputs length: Double, width: Double, front: Double, rear: Double, side: Double
# ---------- c_script: C# ----------
using System;
using System.Collections;
using System.Collections.Generic;

using Rhino;
using Rhino.Geometry;

using Grasshopper;
using Grasshopper.Kernel;
using Grasshopper.Kernel.Data;
using Grasshopper.Kernel.Types;

public class Script_Instance : GH_ScriptInstance
{
    private void RunScript(
		double length,
		double width,
		double front,
		double rear,
		double side,
		ref object siteCurve,
		ref object buildableCurve,
		ref object buildableArea)
    {
        if (length <= 0 || width <= 0)
        {
            Print("Length and width must be greater than zero.");
            return;
        }

        if (front < 0 || rear < 0 || side < 0)
        {
            Print("Setbacks cannot be negative.");
            return;
        }

        double bLength = length - 2 * side;
        double bWidth = width - front - rear;

        if (bLength <= 0 || bWidth <= 0)
        {
            Print("Setbacks are too big: no buildable area is left.");
            return;
        }

        // The site: a rectangle starting at (0, 0, 0)
        Plane plane = Plane.WorldXY;
        Rectangle3d site = new Rectangle3d(plane, length, width);

        // The buildable envelope: starts at (side, rear) and is smaller
        Plane bPlane = new Plane(new Point3d(side, rear, 0), Vector3d.ZAxis);
        Rectangle3d buildable = new Rectangle3d(bPlane, bLength, bWidth);

        double bArea = bLength * bWidth;

        siteCurve = site.ToNurbsCurve();
        buildableCurve = buildable.ToNurbsCurve();
        buildableArea = bArea;

        Print("Site: " + length + " x " + width);
        Print("Buildable: " + bLength + " x " + bWidth);
        Print("Buildable area: " + bArea + " m2");
    }
}
# ---------- end c_script ----------
c_script_2 = CSharpScript(names=panel, counts=panel_3, areas=panel_2)  # -> out, totalArea, schedule; inputs names: list of String, counts: list, areas: list
# ---------- c_script_2: C# ----------
using System;
using System.Collections;
using System.Collections.Generic;

using Rhino;
using Rhino.Geometry;

using Grasshopper;
using Grasshopper.Kernel;
using Grasshopper.Kernel.Data;
using Grasshopper.Kernel.Types;

public class Script_Instance : GH_ScriptInstance
{
    private void RunScript(
		List<string> names,
		List<object> counts,
		List<object> areas,
		ref object totalArea,
		ref object schedule)
    {
        if (names == null || counts == null || areas == null)
        {
            Print("Please connect names, counts and areas.");
            return;
        }

        if (names.Count != counts.Count || names.Count != areas.Count)
        {
            Print("Names, counts and areas must have the same number of items.");
            return;
        }

        double total = 0;
        List<string> rows = new List<string>();

        for (int i = 0; i < names.Count; i++)
        {
            double count = Convert.ToDouble(counts[i].ToString());
            double unitArea = Convert.ToDouble(areas[i].ToString());
            double rowArea = count * unitArea;
            total += rowArea;
            rows.Add(names[i] + ": " + count + " x " + unitArea + " = " + rowArea + " m2");
        }

        totalArea = total;
        schedule = rows;

        Print("Total required area: " + total + " m2");
    }
}
# ---------- end c_script_2 ----------
c_script_3 = CSharpScript(
    length=number_slider,
    width=number_slider_2,
    far=Slider(2, range=0..5),
    coverage=Slider(60, range=0..100),
    floors=Slider(4, range=1..10),
    envelopeArea=c_script.buildableArea)  # -> out, area, maxGFA, maxFootprint, floorArea, fits, actualFootprint; inputs length: Double, width: Double, far: Double, coverage: Double, floors: Int32, envelopeArea: Double
# ---------- c_script_3: C# ----------
using System;
using System.Collections;
using System.Collections.Generic;

using Rhino;
using Rhino.Geometry;

using Grasshopper;
using Grasshopper.Kernel;
using Grasshopper.Kernel.Data;
using Grasshopper.Kernel.Types;

public class Script_Instance : GH_ScriptInstance
{
    private void RunScript(
		double length,
		double width,
		double far,
		double coverage,
		int floors,
		double envelopeArea,
		ref object area,
		ref object maxGFA,
		ref object maxFootprint,
		ref object floorArea,
		ref object fits,
		ref object actualFootprint)
    {
        if (length <= 0 || width <= 0 || far <= 0)
        {
            Print("Length, width and FAR must be greater than zero.");
            return;
        }

        if (coverage <= 0 || coverage > 100)
        {
            Print("Coverage must be between 0 and 100.");
            return;
        }

        if (floors <= 0)
        {
            Print("Floors must be at least 1.");
            return;
        }

        double siteArea = length * width;
        double gfa = siteArea * far;
        double footprint = siteArea * coverage / 100;
        double perFloor = gfa / floors;
        bool isOk = perFloor <= footprint;

        area = siteArea;
        maxGFA = gfa;
        maxFootprint = footprint;
        floorArea = perFloor;
        fits = isOk;

        Print("Site area: " + siteArea + " m2");
        Print("Max GFA: " + gfa + " m2");
        Print("Max footprint: " + footprint + " m2");
        Print("Area per floor: " + perFloor + " m2");

        if (isOk)
        {
            Print("OK: each floor fits within the footprint.");
        }
        else
        {
            Print("WARNING: floor area is bigger than the allowed footprint. Add more floors.");
        }
    }
}
# ---------- end c_script_3 ----------
panel_4 = Panel(c_script_2.schedule)
panel_5 = Panel(c_script_2.totalArea)
panel_6 = Panel(c_script_3.out)
panel_7 = Panel(c_script_3.maxGFA)
panel_8 = Panel(c_script_3.floorArea)
panel_9 = Panel(c_script_3.fits)
panel_10 = Panel(c_script.buildableArea)
panel_11 = Panel(c_script_3.area)
panel_12 = Panel(c_script_3.maxFootprint)
c_script_4 = CSharpScript(maxGFA=c_script_3.maxGFA, requiredArea=c_script_2.totalArea)  # -> out, remaining, usagePercent, report; inputs maxGFA: Double, requiredArea: Double
# ---------- c_script_4: C# ----------
using System;
using System.Collections;
using System.Collections.Generic;

using Rhino;
using Rhino.Geometry;

using Grasshopper;
using Grasshopper.Kernel;
using Grasshopper.Kernel.Data;
using Grasshopper.Kernel.Types;

public class Script_Instance : GH_ScriptInstance
{
    private void RunScript(
		double maxGFA,
		double requiredArea,
		ref object remaining,
		ref object usagePercent,
		ref object report)
    {
        if (maxGFA <= 0)
        {
            Print("Max GFA must be greater than zero.");
            return;
        }

        if (requiredArea < 0)
        {
            Print("Required area cannot be negative.");
            return;
        }

        double left = maxGFA - requiredArea;
        double percent = requiredArea / maxGFA * 100;

        remaining = left;
        usagePercent = percent;

        List<string> lines = new List<string>();
        lines.Add("Max GFA: " + maxGFA + " m2");
        lines.Add("Required program area: " + requiredArea + " m2");
        lines.Add("Remaining area: " + left + " m2");
        lines.Add("GFA usage: " + Math.Round(percent, 1) + " %");

        if (left < 0)
        {
            lines.Add("RESULT: DOES NOT FIT. The program is bigger than the allowed GFA.");
        }
        else if (percent > 90)
        {
            lines.Add("RESULT: FITS, but it is very tight (more than 90% used).");
        }
        else
        {
            lines.Add("RESULT: FITS comfortably.");
        }

        report = lines;

        foreach (string line in lines)
        {
            Print(line);
        }
    }
}
# ---------- end c_script_4 ----------
panel_13 = Panel(c_script_4.report)
panel_14 = Panel(c_script_4.usagePercent)
panel_15 = Panel(c_script_4.remaining)
